# Dynamo graph 01_ValidarRooms.dyn (Dynamo 3.0.0.0)
# author: Murillo Santtos
# Validação visual de Rooms - verifica nome, número, área e status
# packages: DSRevitNodesUI 3.0.0.0, CoreNodeModels 3.0.0.0, DSCoreNodesUI 3.0.0.0

# group: 1. COLETA DE ROOMS
# Seleciona categoria Rooms e coleta todos os elementos
categories = Categories("OST_Rooms")
all_elements_of_category = ElementsOfCategory(Category=categories)

# group: 2. EXTRAÇÃO DE PROPRIEDADES
# Extrai Name, Id, Number e Area de cada Room
extrair_propriedades = CodeBlock(rooms=all_elements_of_category)
# ---------- extrair_propriedades.designscript (4 lines) ----------
names = rooms.Name;
ids = rooms.Id;
numbers = rooms.GetParameterValueByName("Number");
areas = rooms.GetParameterValueByName("Area");
# ----------------------------------------

# group: 3. VALIDAÇÃO E CORES
# Valida cada Room e atribui cor verde (ok) ou vermelha (erro)
validação = CodeBlock(name=extrair_propriedades.names, number=extrair_propriedades.numbers, area=extrair_propriedades.areas)
# ---------- validação.designscript (5 lines) ----------
hasName = name != "" && name != null;
hasNumber = number != "" && number != null;
hasArea = area != null && area > 0;
isValid = hasName && hasNumber && hasArea;
status = isValid ? "VÁLIDO" : "INVÁLIDO";
# ----------------------------------------
filtrar_inválidos = CodeBlock(rooms=all_elements_of_category, isValid=validação.out0) { mask = DSCore.List.FilterByBoolMask(rooms, isValid); invalidRooms = mask["out"]; }
cor_verde_válido = CodeBlock { Color.ByARGB(255,0,255,0); }
cor_vermelha_inválido = CodeBlock { Color.ByARGB(255,255,0,0); }
selecionar_cor = CodeBlock(isValid=validação.out0, green=cor_verde_válido, red=cor_vermelha_inválido) { colors = isValid ? green : red; }

# group: 4. SAÍDAS
# Tabela de validação, rooms inválidos e cores
tabela_de_validação = List.Create(item0=extrair_propriedades.ids, item1=extrair_propriedades.names, item2=extrair_propriedades.numbers, item3=extrair_propriedades.areas, item4=validação.out1)
watch_tabela = Watch(tabela_de_validação)  # graph output
watch_rooms_inválidos = Watch(filtrar_inválidos)  # graph output
watch_cores = Watch(selecionar_cor)  # graph output
