# Dynamo graph 02_CriarSpacesMassivo.dyn (Dynamo 3.0.0.0)
# author: Murillo Santtos
# Criação massiva de Spaces a partir de Rooms existentes - copia nome, número e localização
# packages: DSRevitNodesUI 3.0.0.0, CoreNodeModels 3.0.0.0, RevitNodes 3.0.0.0

# group: 1. COLETA
# Obtém todos os Rooms e Spaces existentes
categories_rooms = Categories("OST_Rooms")
all_rooms = ElementsOfCategory(Category=categories_rooms)
categories_spaces = Categories("OST_MEPSpaces")
all_spaces_existentes = ElementsOfCategory(Category=categories_spaces)

# group: 2. FILTRO E VERIFICAÇÃO
# Filtra colocados e identifica Rooms sem Space correspondente
extrair_propriedades_room = CodeBlock(rooms=all_rooms)
# ---------- extrair_propriedades_room.designscript (6 lines) ----------
names = rooms.Name;
ids = rooms.Id;
numbers = rooms.GetParameterValueByName("Number");
levels = rooms.GetParameterValueByName("Level");
locations = rooms.GetLocation();
areas = rooms.GetParameterValueByName("Area");
# ----------------------------------------
isPlaced = CodeBlock(rooms=all_rooms, areas=extrair_propriedades_room.areas) { isPlaced = areas != null && areas > 0; }  # "Room.IsPlaced"
filtrar_rooms_colocados = List.FilterByBoolMask(list=all_rooms, mask=isPlaced)
verificar_rooms_sem_space = CodeBlock(placedRooms=filtrar_rooms_colocados.in, existSpaces=all_spaces_existentes)
# ---------- verificar_rooms_sem_space.designscript (5 lines) ----------
spNames = existSpaces.Name;
rNames = placedRooms.Name;
needsSpace = List.Map(rNames, Function(n : var) { return !List.Contains(spNames, n); });
roomFilter = DSCore.List.FilterByBoolMask(placedRooms, needsSpace);
roomsNeedingSpace = roomFilter["in"];
# ----------------------------------------

# group: 3. CRIAÇÃO DE SPACES
# Cria Space para cada Room faltante e copia Name/Number
dados_dos_rooms_faltantes = CodeBlock(roomsSemSpace=verificar_rooms_sem_space.out1)
# ---------- dados_dos_rooms_faltantes.designscript (4 lines) ----------
rLevels = roomsSemSpace.Level;
rPoints = roomsSemSpace.GetLocation();
rNames = roomsSemSpace.Name;
rNumbers = roomsSemSpace.GetParameterValueByName("Number");
# ----------------------------------------
byLevelAndPoint = CodeBlock(lvl=dados_dos_rooms_faltantes.rLevels, pt=dados_dos_rooms_faltantes.rPoints) { newSpaces = Revit.Elements.Space.ByLevelAndPoint(lvl, pt); }  # "Space.ByLevelAndPoint"
copiar_name_e_number = CodeBlock(spaces=byLevelAndPoint, nomes=dados_dos_rooms_faltantes.rNames, numeros=dados_dos_rooms_faltantes.rNumbers) { setName = spaces.SetParameterByName("Name", nomes); setNumber = spaces.SetParameterByName("Number", numeros); }

# group: 4. SAÍDAS
# Rooms sem Space, Spaces criados e tabela Room↔Space
watch_rooms_sem_space = Watch(verificar_rooms_sem_space.out1)  # graph output
watch_spaces_criados = Watch(byLevelAndPoint)  # graph output
tabela_room_space = List.Create(item0=verificar_rooms_sem_space.out1, item1=byLevelAndPoint, item2=copiar_name_e_number.setName)
watch_tabela_consolidada = Watch(tabela_room_space)  # graph output
