# Dynamo graph 03_InserirEquipamentos.dyn (Dynamo 3.0.0.0)
# author: Murillo Santtos
# Inserção paramétrica de equipamentos MEP em massa via JSON - FamilyInstance.ByPoint com rotação e parâmetros
# packages: DynamoCore 3.0.0.0, CoreNodeModels 3.0.0.0, RevitNodes 3.0.0.0, PythonNodeModels 3.0.0.0

# group: 1. LEITURA JSON
# Lê o arquivo JSON de entrada e extrai familyName, typeName, points, levels, vectors e parameters
json_path = CodeBlock { jsonPath = "C:/PluginRevit/Data/Config/equipamentos_input.json"; }  # graph input
parseJSON = Data.ParseJSON(filePath=json_path)
extrair_campos_json = CodeBlock(jsonData=parseJSON)
# ---------- extrair_campos_json.designscript (8 lines) ----------
familyName = jsonData["familyName"];
typeName = jsonData["typeName"];
ptData = jsonData["locationPoints"];
points = List.Map(ptData, Function(p) { return Autodesk.DesignScript.Geometry.Point.ByCoordinates(p["x"], p["y"], p["z"]); });
levelNames = jsonData["levels"];
vecData = jsonData["orientationVectors"];
vectors = List.Map(vecData, Function(v) { return Autodesk.DesignScript.Geometry.Vector.ByCoordinates(v["x"], v["y"], v["z"]); });
params = jsonData["parameters"];
# ----------------------------------------

# group: 2. RESOLUÇÃO DE TIPOS
# Resolve FamilyType e Levels por nome
resolver_familytype = CodeBlock(familyName=extrair_campos_json.out0, typeName=extrair_campos_json.out1) { allTypes = Revit.Elements.FamilyType.ByFamilyNameAndTypeName(familyName, typeName); familyType = allTypes; }
resolver_levels = CodeBlock(levelNames=extrair_campos_json.out3) { levels = List.Map(levelNames, Function(n) { return Revit.Elements.Level.ByName(n); }); }

# group: 3. INSERÇÃO + ROTAÇÃO + PARAMS
# Cria FamilyInstance, aplica rotação por vetor e define parâmetros
byPointAndLevel = CodeBlock(familyType=resolver_familytype, points=extrair_campos_json.out2, levels=resolver_levels) { instances = Revit.Elements.FamilyInstance.ByPointAndLevel(familyType, points, levels); }  # "FamilyInstance.ByPointAndLevel"
python_rotação_por_vetor = Python(IN[0]=byPointAndLevel, IN[1]=extrair_campos_json.out4)  # CPython3
# ---------- python_rotação_por_vetor.python (35 lines) ----------
import clr
clr.AddReference('RevitAPI')
clr.AddReference('RevitServices')
from Autodesk.Revit.DB import *
from RevitServices.Persistence import DocumentManager
from RevitServices.Transactions import TransactionManager
import math

doc = DocumentManager.Instance.CurrentDBDocument
instances = UnwrapElement(IN[0]) if isinstance(IN[0], list) else [UnwrapElement(IN[0])]
vectors = IN[1] if isinstance(IN[1], list) else [IN[1]]

results = []

TransactionManager.Instance.EnsureInTransaction(doc)

for i, inst in enumerate(instances):
    try:
        if i < len(vectors) and vectors[i] is not None:
            vec = vectors[i]
            vx = vec.X
            vy = vec.Y
            angle = math.atan2(vy, vx)
            loc = inst.Location
            if hasattr(loc, 'Point'):
                pt = loc.Point
                axis = Line.CreateBound(pt, XYZ(pt.X, pt.Y, pt.Z + 1))
                ElementTransformUtils.RotateElement(doc, inst.Id, axis, angle)
        results.append(inst)
    except Exception as e:
        results.append(str(e))

TransactionManager.Instance.TransactionTaskDone()

OUT = results
# ----------------------------------------
aplicar_parâmetros = CodeBlock(instances=python_rotação_por_vetor, params=extrair_campos_json.out5)
# ---------- aplicar_parâmetros.designscript (15 lines) ----------
keys = Dictionary.Keys(params);
vals = Dictionary.Values(params);
setResults = [Imperative]
{
    results = {};
    for (inst in instances)
    {
        for (k in 0..List.Count(keys)-1)
        {
            inst.SetParameterByName(keys[k], vals[k]);
        }
        results = List.AddItemToEnd(inst, results);
    }
    return results;
};
# ----------------------------------------

# group: 4. SAÍDAS
# Instâncias criadas, mapa ID↔Params e JSON de retorno
watch_instâncias = Watch(aplicar_parâmetros)  # graph output
extrair_ids_e_names = CodeBlock(instances=aplicar_parâmetros) { ids = instances.Id; names = instances.Name; }
mapa_id_nome = List.Create(item0=extrair_ids_e_names.ids, item1=extrair_ids_e_names.names)
transpose = List.Transpose(lists=mapa_id_nome)
watch_mapa_id_params = Watch(transpose)  # graph output
python_gerar_json_saída = Python(IN[0]=aplicar_parâmetros, IN[1]=extrair_campos_json.out2)  # CPython3
# ---------- python_gerar_json_saída.python (43 lines) ----------
import clr
import json
import time
from datetime import datetime

start = time.time()
instances = IN[0] if isinstance(IN[0], list) else [IN[0]]
points = IN[1] if isinstance(IN[1], list) else [IN[1]]

created = []
failed = []

for i, inst in enumerate(instances):
    try:
        if isinstance(inst, str):
            pt = points[i] if i < len(points) else None
            failed.append({
                "index": i,
                "point": str(pt) if pt else "unknown",
                "error": inst
            })
        else:
            unwrapped = UnwrapElement(inst)
            created.append({
                "index": i,
                "elementId": unwrapped.Id.IntegerValue
            })
    except Exception as e:
        failed.append({"index": i, "error": str(e)})

end = time.time()

result = {
    "success": len(failed) == 0,
    "createdInstances": [c["elementId"] for c in created],
    "createdCount": len(created),
    "failed": failed,
    "failedCount": len(failed),
    "timestamp": datetime.utcnow().isoformat() + "Z",
    "executionTimeMs": int((end - start) * 1000)
}

OUT = json.dumps(result, indent=2)
# ----------------------------------------
watch_out_json = Watch(python_gerar_json_saída)  # graph output
