# Dynamo graph 04_ValidarPosicionamento.dyn (Dynamo 3.0.0.0)
# author: Murillo Santtos
# Validação de posicionamento MEP - verifica distância equipamento↔parede contra offsets esperados
# packages: DynamoCore 3.0.0.0, DSRevitNodesUI 3.0.0.0, CoreNodeModels 3.0.0.0, PythonNodeModels 3.0.0.0

# group: 1. ENTRADA JSON
# Lê JSON com elementIds, expectedOffsets e tolerance
json_path = CodeBlock { jsonPath = "C:/PluginRevit/Data/Config/validacao_input.json"; }  # graph input
parseJSON = Data.ParseJSON(filePath=json_path)
extrair_campos = CodeBlock(data=parseJSON) { elemIds = data["elementIds"]; offsets = data["expectedOffsets"]; tolerance = data["tolerance"]; }

# group: 2. COLETA DE ELEMENTOS
# Resolve equipamentos por ID e coleta todas as paredes
resolver_elementos_por_id = CodeBlock(ids=extrair_campos.elemIds) { elements = List.Map(ids, Function(id) { return Revit.Elements.ElementSelector.ById(id); }); }
categories_walls = Categories("OST_Walls")
all_walls = ElementsOfCategory(Category=categories_walls)

# group: 3. VALIDAÇÃO DE DISTÂNCIAS
# Python: projeta ponto na curva da parede, calcula distância, classifica OK/FORA_DO_OFFSET/SEM_PAREDE
python_validar_distâncias = Python(IN[0]=resolver_elementos_por_id, IN[1]=all_walls, IN[2]=extrair_campos.offsets, IN[3]=extrair_campos.tolerance)  # CPython3
# ---------- python_validar_distâncias.python (121 lines) ----------
import clr
clr.AddReference('RevitAPI')
clr.AddReference('RevitServices')
clr.AddReference('ProtoGeometry')
from Autodesk.Revit.DB import *
from Autodesk.DesignScript.Geometry import Point as DSPoint
from RevitServices.Persistence import DocumentManager
import json
import time
from datetime import datetime

doc = DocumentManager.Instance.CurrentDBDocument
start = time.time()

elements = IN[0] if isinstance(IN[0], list) else [IN[0]]
walls = IN[1] if isinstance(IN[1], list) else [IN[1]]
offsets = IN[2] if isinstance(IN[2], list) else [IN[2]]
tolerance = float(IN[3]) if IN[3] else 0.05

results = []
statuses = []
distances = []

wall_elements = [UnwrapElement(w) for w in walls]

for i, elem in enumerate(elements):
    try:
        el = UnwrapElement(elem)
        loc = el.Location
        if not hasattr(loc, 'Point'):
            results.append({
                "elementId": el.Id.IntegerValue,
                "realDistance": -1,
                "expectedOffset": offsets[i] if i < len(offsets) else 0,
                "difference": -1,
                "status": "SEM_LOCALIZACAO"
            })
            statuses.append("SEM_LOCALIZACAO")
            distances.append(-1)
            continue

        pt = loc.Point
        expected = offsets[i] if i < len(offsets) else 0

        min_dist = float('inf')
        closest_wall_id = None

        for wall in wall_elements:
            try:
                wall_loc = wall.Location
                if hasattr(wall_loc, 'Curve'):
                    curve = wall_loc.Curve
                    result = curve.Project(pt)
                    if result is not None:
                        dist = pt.DistanceTo(result.XYZPoint)
                        dist_m = dist * 0.3048
                        if dist_m < min_dist:
                            min_dist = dist_m
                            closest_wall_id = wall.Id.IntegerValue
            except:
                continue

        if min_dist == float('inf'):
            results.append({
                "elementId": el.Id.IntegerValue,
                "realDistance": -1,
                "expectedOffset": expected,
                "difference": -1,
                "status": "SEM_PAREDE"
            })
            statuses.append("SEM_PAREDE")
            distances.append(-1)
        else:
            diff = abs(min_dist - expected)
            if diff <= tolerance:
                status = "OK"
            else:
                status = "FORA_DO_OFFSET"

            results.append({
                "elementId": el.Id.IntegerValue,
                "wallId": closest_wall_id,
                "realDistance": round(min_dist, 4),
                "expectedOffset": expected,
                "difference": round(diff, 4),
                "status": status
            })
            statuses.append(status)
            distances.append(round(min_dist, 4))
    except Exception as e:
        results.append({
            "elementId": -1,
            "realDistance": -1,
            "expectedOffset": 0,
            "difference": -1,
            "status": "ERRO: " + str(e)
        })
        statuses.append("ERRO")
        distances.append(-1)

end = time.time()

ok_count = sum(1 for r in results if r["status"] == "OK")
fail_count = sum(1 for r in results if r["status"] == "FORA_DO_OFFSET")
no_wall = sum(1 for r in results if r["status"] == "SEM_PAREDE")

output = {
    "validated": results,
    "summary": {
        "total": len(results),
        "ok": ok_count,
        "foraDoOffset": fail_count,
        "semParede": no_wall,
        "erros": len(results) - ok_count - fail_count - no_wall
    },
    "tolerance": tolerance,
    "timestamp": datetime.utcnow().isoformat() + "Z",
    "executionTimeMs": int((end - start) * 1000)
}

OUT = [json.dumps(output, indent=2), statuses, distances]
# ----------------------------------------
separar_saídas_python = CodeBlock(pyOut=python_validar_distâncias) { jsonResult = pyOut[0]; statuses = pyOut[1]; distances = pyOut[2]; }
classificar_cores = CodeBlock(statuses=separar_saídas_python.statuses)
# ---------- classificar_cores.designscript (7 lines) ----------
isOk = List.Map(statuses, Function(s) { return s == "OK"; });
green = Color.ByARGB(255, 0, 200, 0);
red = Color.ByARGB(255, 255, 50, 50);
yellow = Color.ByARGB(255, 255, 200, 0);
colors = List.Map(statuses, Function(s) {
    return s == "OK" ? green : (s == "SEM_PAREDE" ? yellow : red);
});
# ----------------------------------------

# group: 4. SAÍDAS
# Tabela, cores por status e JSON de retorno
watch_cores = Watch(classificar_cores.out1)  # graph output
montar_tabela = CodeBlock(ids=extrair_campos.elemIds, dists=separar_saídas_python.distances, offsets=extrair_campos.offsets, statuses=separar_saídas_python.statuses)
# ---------- montar_tabela.designscript (3 lines) ----------
headers = {"ElementId", "Dist.Real", "Offset Esp.", "Status"};
rows = List.Transpose({ids, dists, offsets, statuses});
table = List.AddItemToFront(headers, rows);
# ----------------------------------------
watch_tabela_validação = Watch(montar_tabela)  # graph output
watch_out_json = Watch(separar_saídas_python.jsonResult)  # graph output
