# Dynamo graph 05_GerarRamalAguaFria.dyn (Dynamo 3.0.0.0)
# author: Murillo Santtos
# Traçado automático de ramais horizontais de água fria - conecta alimentador principal aos pontos de consumo
# packages: DynamoCore 3.0.0.0, CoreNodeModels 3.0.0.0, PythonNodeModels 3.0.0.0

# group: 1. ENTRADA JSON
# Lê fixtures[], mainFeedPoint, pipeTypeId, diameter, offsetZ, systemTypeId, tolerance
json_path = CodeBlock { jsonPath = "C:/PluginRevit/Data/Config/ramal_af_input.json"; }  # graph input
parseJSON = Data.ParseJSON(filePath=json_path)
extrair_campos_json = CodeBlock(data=parseJSON)
# ---------- extrair_campos_json.designscript (8 lines) ----------
fixtureIds = data["fixtures"];
fp = data["mainFeedPoint"];
feedPt = Autodesk.DesignScript.Geometry.Point.ByCoordinates(fp["x"], fp["y"], fp["z"]);
pipeTypeId = data["pipeTypeId"];
diameter = data["diameter"];
offsetZ = data["offsetZ"];
systemTypeId = data["systemTypeId"];
tolerance = data["tolerance"];
# ----------------------------------------

# group: 2. ORDENAÇÃO GEOMÉTRICA
# Resolve fixtures, extrai posições, ordena por distância ao alimentador, gera polilinha
resolver_fixtures = CodeBlock(ids=extrair_campos_json.out0)
# ---------- resolver_fixtures.designscript (2 lines) ----------
fixtures = List.Map(ids, Function(id) { return Revit.Elements.ElementSelector.ById(id); });
fixturePoints = List.Map(fixtures, Function(f) { return f.GetLocation(); });
# ----------------------------------------
python_ordenar_e_traçar_caminho = Python(IN[0]=resolver_fixtures.out1, IN[1]=extrair_campos_json.out1, IN[2]=extrair_campos_json.out0, IN[3]=extrair_campos_json.out4)  # CPython3
# ---------- python_ordenar_e_traçar_caminho.python (49 lines) ----------
import clr
clr.AddReference('ProtoGeometry')
from Autodesk.DesignScript.Geometry import Point as DSPoint, Line as DSLine, Vector as DSVector
import math

fix_pts = IN[0] if isinstance(IN[0], list) else [IN[0]]
feed_pt = IN[1]
fix_ids = IN[2] if isinstance(IN[2], list) else [IN[2]]
offset_z = float(IN[3])

fx = feed_pt.X
fy = feed_pt.Y

paired = []
for i, pt in enumerate(fix_pts):
    try:
        dx = pt.X - fx
        dy = pt.Y - fy
        dist = math.sqrt(dx*dx + dy*dy)
        paired.append((i, pt, dist, fix_ids[i]))
    except:
        continue

paired.sort(key=lambda x: x[2])

ordered_pts = []
ordered_ids = []
for item in paired:
    ordered_pts.append(DSPoint.ByCoordinates(item[1].X, item[1].Y, offset_z))
    ordered_ids.append(item[3])

feed_hz = DSPoint.ByCoordinates(fx, fy, offset_z)

start_pts = []
end_pts = []
lines = []

prev = feed_hz
for pt in ordered_pts:
    start_pts.append(prev)
    end_pts.append(pt)
    try:
        ln = DSLine.ByStartPointEndPoint(prev, pt)
        lines.append(ln)
    except:
        lines.append(None)
    prev = pt

OUT = [ordered_pts, ordered_ids, start_pts, end_pts, lines, feed_hz]
# ----------------------------------------
separar_dados_ordenados = CodeBlock(pyOut=python_ordenar_e_traçar_caminho)
# ---------- separar_dados_ordenados.designscript (6 lines) ----------
orderedPts = pyOut[0];
orderedIds = pyOut[1];
startPts = pyOut[2];
endPts = pyOut[3];
lines = pyOut[4];
feedHz = pyOut[5];
# ----------------------------------------

# group: 3. CRIAÇÃO DE PIPES
# Python: Pipe.Create para cada trecho, define diâmetro, conecta via ConnectorManager
python_criar_pipes_e_conectar = Python(IN[0]=separar_dados_ordenados.startPts, IN[1]=separar_dados_ordenados.endPts, IN[2]=extrair_campos_json.out2, IN[3]=extrair_campos_json.out5, IN[4]=extrair_campos_json.out3, IN[5]=separar_dados_ordenados.orderedIds, IN[6]=extrair_campos_json.out6)  # CPython3
# ---------- python_criar_pipes_e_conectar.python (106 lines) ----------
import clr
clr.AddReference('RevitAPI')
clr.AddReference('RevitServices')
from Autodesk.Revit.DB import *
from Autodesk.Revit.DB.Plumbing import Pipe, PipeType
from Autodesk.Revit.DB.Mechanical import MechanicalSystemType
from RevitServices.Persistence import DocumentManager
from RevitServices.Transactions import TransactionManager
import json
import time
from datetime import datetime

start_time = time.time()
doc = DocumentManager.Instance.CurrentDBDocument

start_pts = IN[0] if isinstance(IN[0], list) else [IN[0]]
end_pts = IN[1] if isinstance(IN[1], list) else [IN[1]]
pipe_type_id = int(IN[2])
system_type_id = int(IN[3])
diameter_mm = float(IN[4])
ordered_ids = IN[5] if isinstance(IN[5], list) else [IN[5]]
tolerance = float(IN[6]) if IN[6] else 0.01

diameter_ft = diameter_mm / 304.8

pipe_type_eid = ElementId(pipe_type_id)
system_type_eid = ElementId(system_type_id)

levels = FilteredElementCollector(doc).OfClass(Level).ToElements()
base_level = levels[0] if levels else None

created_pipes = []
failed = []
pipe_elements = []

TransactionManager.Instance.EnsureInTransaction(doc)

for i in range(len(start_pts)):
    try:
        sp = start_pts[i]
        ep = end_pts[i]
        
        p1 = XYZ(sp.X / 304.8, sp.Y / 304.8, sp.Z / 304.8) if hasattr(sp, 'X') else XYZ(0,0,0)
        p2 = XYZ(ep.X / 304.8, ep.Y / 304.8, ep.Z / 304.8) if hasattr(ep, 'X') else XYZ(0,0,0)
        
        dist = p1.DistanceTo(p2)
        if dist < 0.01:
            failed.append({"index": i, "error": "Points too close"})
            continue
        
        pipe = Pipe.Create(doc, system_type_eid, pipe_type_eid, base_level.Id, p1, p2)
        
        param_diam = pipe.get_Parameter(BuiltInParameter.RBS_PIPE_DIAMETER_PARAM)
        if param_diam and not param_diam.IsReadOnly:
            param_diam.Set(diameter_ft)
        
        created_pipes.append(pipe.Id.IntegerValue)
        pipe_elements.append(pipe)
    except Exception as e:
        failed.append({"index": i, "error": str(e)})

connectivity_ok = True
for i in range(len(pipe_elements) - 1):
    try:
        c1 = pipe_elements[i].ConnectorManager.Connectors
        c2 = pipe_elements[i+1].ConnectorManager.Connectors
        
        best_dist = float('inf')
        best_pair = None
        
        for conn1 in c1:
            for conn2 in c2:
                d = conn1.Origin.DistanceTo(conn2.Origin)
                if d < best_dist:
                    best_dist = d
                    best_pair = (conn1, conn2)
        
        if best_pair and best_dist < tolerance:
            if not best_pair[0].IsConnected and not best_pair[1].IsConnected:
                best_pair[0].ConnectTo(best_pair[1])
        elif best_dist >= tolerance:
            connectivity_ok = False
    except:
        connectivity_ok = False

TransactionManager.Instance.TransactionTaskDone()

end_time = time.time()

status = "OK" if connectivity_ok and len(failed) == 0 else "ERRO_CONECTIVIDADE" if not connectivity_ok else "ERRO_PARCIAL"

result = {
    "success": status == "OK",
    "createdPipes": created_pipes,
    "count": len(created_pipes),
    "failed": failed,
    "failedCount": len(failed),
    "connectivityValid": connectivity_ok,
    "status": status,
    "diameter_mm": diameter_mm,
    "fixtureOrder": ordered_ids,
    "executionTimeMs": int((end_time - start_time) * 1000),
    "timestamp": datetime.utcnow().isoformat() + "Z"
}

OUT = [json.dumps(result, indent=2), created_pipes, status, pipe_elements]
# ----------------------------------------
separar_resultados = CodeBlock(pyOut=python_criar_pipes_e_conectar) { jsonResult = pyOut[0]; pipeIds = pyOut[1]; status = pyOut[2]; pipes = pyOut[3]; }

# group: 4. SAÍDAS
# Pipe IDs, Status de conectividade e JSON de retorno
watch_pipe_ids = Watch(separar_resultados.pipeIds)  # graph output
watch_status = Watch(separar_resultados.status)  # graph output
watch_out_json = Watch(separar_resultados.jsonResult)  # graph output
