# Dynamo graph 06_GerarRamalEsgoto.dyn (Dynamo 3.0.0.0)
# author: Murillo Santtos
# Traçado automático de ramais de esgoto sanitário com inclinação - conecta fixtures à prumada
# packages: DynamoCore 3.0.0.0, CoreNodeModels 3.0.0.0, PythonNodeModels 3.0.0.0

# group: 1. ENTRADA JSON
# Lê fixtures[], stackPoint, pipeTypeId, diameter, slopePercent, baseOffsetZ, systemTypeId
json_path = CodeBlock { jsonPath = "C:/PluginRevit/Data/Config/ramal_esgoto_input.json"; }  # graph input
parseJSON = Data.ParseJSON(filePath=json_path)
extrair_campos_json = CodeBlock(data=parseJSON)
# ---------- extrair_campos_json.designscript (9 lines) ----------
fixtureIds = data["fixtures"];
sp = data["stackPoint"];
stackPt = Autodesk.DesignScript.Geometry.Point.ByCoordinates(sp["x"], sp["y"], sp["z"]);
pipeTypeId = data["pipeTypeId"];
diameter = data["diameter"];
slopePercent = data["slopePercent"];
baseOffsetZ = data["baseOffsetZ"];
systemTypeId = data["systemTypeId"];
tolerance = data["tolerance"];
# ----------------------------------------

# group: 2. ORDENAÇÃO + INCLINAÇÃO
# Ordena fixtures por distância à prumada (mais longe primeiro), calcula Z com slope
resolver_fixtures = CodeBlock(ids=extrair_campos_json.out0)
# ---------- resolver_fixtures.designscript (2 lines) ----------
fixtures = List.Map(ids, Function(id) { return Revit.Elements.ElementSelector.ById(id); });
fixPts = List.Map(fixtures, Function(f) { return f.GetLocation(); });
# ----------------------------------------
python_ordenar_e_calcular = Python(IN[0]=resolver_fixtures.out1, IN[1]=extrair_campos_json.out1, IN[2]=extrair_campos_json.out0, IN[3]=extrair_campos_json.out4, IN[4]=extrair_campos_json.out5)  # "Python - Ordenar e Calcular Inclinação"; CPython3
# ---------- python_ordenar_e_calcular.python (75 lines) ----------
import clr
clr.AddReference('ProtoGeometry')
from Autodesk.DesignScript.Geometry import Point as DSPoint
import math

fix_pts = IN[0] if isinstance(IN[0], list) else [IN[0]]
stack_pt = IN[1]
fix_ids = IN[2] if isinstance(IN[2], list) else [IN[2]]
slope_pct = float(IN[3])
base_z = float(IN[4])

sx = stack_pt.X
sy = stack_pt.Y

paired = []
for i, pt in enumerate(fix_pts):
    try:
        dx = pt.X - sx
        dy = pt.Y - sy
        dist = math.sqrt(dx*dx + dy*dy)
        paired.append((i, pt, dist, fix_ids[i]))
    except:
        continue

paired.sort(key=lambda x: x[2], reverse=True)

start_pts = []
end_pts = []
ordered_ids = []
slopes = []
drops = []

stack_hz = DSPoint.ByCoordinates(sx, sy, base_z)

cum_drop = 0.0

for idx, item in enumerate(paired):
    pt = item[1]
    fid = item[3]
    
    dx = pt.X - sx
    dy = pt.Y - sy
    dist_to_stack = math.sqrt(dx*dx + dy*dy)
    
    seg_drop = dist_to_stack * (slope_pct / 100.0)
    
    z_start = base_z + seg_drop
    z_end = base_z + cum_drop
    
    sp = DSPoint.ByCoordinates(pt.X, pt.Y, z_start)
    
    if idx < len(paired) - 1:
        nxt = paired[idx + 1]
        npt = nxt[1]
        dx2 = npt.X - sx
        dy2 = npt.Y - sy
        d2 = math.sqrt(dx2*dx2 + dy2*dy2)
        z_end_seg = base_z + d2 * (slope_pct / 100.0)
        ep = DSPoint.ByCoordinates(npt.X, npt.Y, z_end_seg)
    else:
        ep = DSPoint.ByCoordinates(sx, sy, base_z)
    
    start_pts.append(sp)
    end_pts.append(ep)
    ordered_ids.append(fid)
    
    dx_seg = ep.X - sp.X
    dy_seg = ep.Y - sp.Y
    seg_len = math.sqrt(dx_seg*dx_seg + dy_seg*dy_seg)
    actual_drop = sp.Z - ep.Z
    actual_slope = (actual_drop / seg_len * 100.0) if seg_len > 0 else 0
    slopes.append(round(actual_slope, 3))
    drops.append(round(actual_drop, 4))

OUT = [start_pts, end_pts, ordered_ids, slopes, drops, stack_hz]
# ----------------------------------------
separar_dados_inclinados = CodeBlock(pyOut=python_ordenar_e_calcular) { startPts = pyOut[0]; endPts = pyOut[1]; orderedIds = pyOut[2]; slopes = pyOut[3]; drops = pyOut[4]; stackHz = pyOut[5]; }

# group: 3. CRIAÇÃO DE PIPES COM SLOPE
# Pipe.Create + diâmetro + RBS_PIPE_SLOPE + ConnectorManager
python_criar_pipes_com_slope = Python(IN[0]=separar_dados_inclinados.startPts, IN[1]=separar_dados_inclinados.endPts, IN[2]=extrair_campos_json.out2, IN[3]=extrair_campos_json.out6, IN[4]=extrair_campos_json.out3, IN[5]=separar_dados_inclinados.orderedIds, IN[6]=separar_dados_inclinados.slopes, IN[7]=extrair_campos_json.out4, IN[8]=extrair_campos_json.out7)  # CPython3
# ---------- python_criar_pipes_com_slope.python (133 lines) ----------
import clr
clr.AddReference('RevitAPI')
clr.AddReference('RevitServices')
from Autodesk.Revit.DB import *
from Autodesk.Revit.DB.Plumbing import Pipe
from RevitServices.Persistence import DocumentManager
from RevitServices.Transactions import TransactionManager
import json
import time
import math
from datetime import datetime

start_time = time.time()
doc = DocumentManager.Instance.CurrentDBDocument

start_pts = IN[0] if isinstance(IN[0], list) else [IN[0]]
end_pts = IN[1] if isinstance(IN[1], list) else [IN[1]]
pipe_type_id = int(IN[2])
system_type_id = int(IN[3])
diameter_mm = float(IN[4])
ordered_ids = IN[5] if isinstance(IN[5], list) else [IN[5]]
slopes = IN[6] if isinstance(IN[6], list) else [IN[6]]
slope_pct = float(IN[7])
tolerance = float(IN[8]) if IN[8] else 0.01

diameter_ft = diameter_mm / 304.8
pipe_type_eid = ElementId(pipe_type_id)
system_type_eid = ElementId(system_type_id)

levels = FilteredElementCollector(doc).OfClass(Level).ToElements()
base_level = levels[0] if levels else None

created_pipes = []
failed = []
pipe_elements = []
actual_slopes = []

TransactionManager.Instance.EnsureInTransaction(doc)

for i in range(len(start_pts)):
    try:
        sp = start_pts[i]
        ep = end_pts[i]
        
        p1 = XYZ(sp.X / 304.8, sp.Y / 304.8, sp.Z / 304.8)
        p2 = XYZ(ep.X / 304.8, ep.Y / 304.8, ep.Z / 304.8)
        
        dist = p1.DistanceTo(p2)
        if dist < 0.01:
            failed.append({"index": i, "fixtureId": ordered_ids[i] if i < len(ordered_ids) else -1, "error": "Points too close"})
            continue
        
        pipe = Pipe.Create(doc, system_type_eid, pipe_type_eid, base_level.Id, p1, p2)
        
        param_diam = pipe.get_Parameter(BuiltInParameter.RBS_PIPE_DIAMETER_PARAM)
        if param_diam and not param_diam.IsReadOnly:
            param_diam.Set(diameter_ft)
        
        param_slope = pipe.get_Parameter(BuiltInParameter.RBS_PIPE_SLOPE)
        if param_slope and not param_slope.IsReadOnly:
            param_slope.Set(slope_pct / 100.0)
        
        dz = abs(p1.Z - p2.Z)
        dxy = math.sqrt((p2.X-p1.X)**2 + (p2.Y-p1.Y)**2)
        actual_sl = (dz / dxy * 100.0) if dxy > 0 else 0
        actual_slopes.append(round(actual_sl, 3))
        
        created_pipes.append(pipe.Id.IntegerValue)
        pipe_elements.append(pipe)
    except Exception as e:
        failed.append({"index": i, "fixtureId": ordered_ids[i] if i < len(ordered_ids) else -1, "error": str(e)})

connectivity_ok = True
for i in range(len(pipe_elements) - 1):
    try:
        c1 = pipe_elements[i].ConnectorManager.Connectors
        c2 = pipe_elements[i+1].ConnectorManager.Connectors
        best_dist = float('inf')
        best_pair = None
        for conn1 in c1:
            for conn2 in c2:
                d = conn1.Origin.DistanceTo(conn2.Origin)
                if d < best_dist:
                    best_dist = d
                    best_pair = (conn1, conn2)
        if best_pair and best_dist < tolerance:
            if not best_pair[0].IsConnected and not best_pair[1].IsConnected:
                best_pair[0].ConnectTo(best_pair[1])
        elif best_dist >= tolerance:
            connectivity_ok = False
    except:
        connectivity_ok = False

slope_ok = True
min_slope = slope_pct * 0.8
for sl in actual_slopes:
    if sl < min_slope:
        slope_ok = False
        break

TransactionManager.Instance.TransactionTaskDone()

end_time = time.time()
avg_slope = sum(actual_slopes) / len(actual_slopes) if actual_slopes else 0

if not connectivity_ok:
    status = "ERRO_CONECTIVIDADE"
elif not slope_ok:
    status = "ERRO_INCLINACAO"
elif len(failed) > 0:
    status = "ERRO_PARCIAL"
else:
    status = "OK"

result = {
    "success": status == "OK",
    "createdPipes": created_pipes,
    "count": len(created_pipes),
    "failed": failed,
    "failedCount": len(failed),
    "avgSlope": round(avg_slope, 3),
    "targetSlope": slope_pct,
    "slopesPerSegment": actual_slopes,
    "connectivityValid": connectivity_ok,
    "slopeValid": slope_ok,
    "status": status,
    "diameter_mm": diameter_mm,
    "fixtureOrder": ordered_ids,
    "executionTimeMs": int((end_time - start_time) * 1000),
    "timestamp": datetime.utcnow().isoformat() + "Z"
}

OUT = [json.dumps(result, indent=2), created_pipes, status, actual_slopes]
# ----------------------------------------
separar_resultados = CodeBlock(pyOut=python_criar_pipes_com_slope) { jsonResult = pyOut[0]; pipeIds = pyOut[1]; status = pyOut[2]; actualSlopes = pyOut[3]; }

# group: 4. SAÍDAS
# Pipe IDs, Status, Inclinações por segmento e JSON completo
watch_pipe_ids = Watch(separar_resultados.pipeIds)  # graph output
watch_status = Watch(separar_resultados.status)  # graph output
watch_inclinações = Watch(separar_resultados.actualSlopes)  # graph output
watch_out_json = Watch(separar_resultados.jsonResult)  # graph output
