# Dynamo graph 07_AplicarInclinacao.dyn (Dynamo 3.0.0.0)
# author: Murillo Santtos
# Ajuste automático de declividade em tubulações de esgoto - recalcula Z com slope% e valida inclinação mínima
# packages: DynamoCore 3.0.0.0, CoreNodeModels 3.0.0.0, PythonNodeModels 3.0.0.0

# group: 1. ENTRADA JSON
# Lê pipes[], slopePercent, baseZMode (start/end/auto), tolerance, systemTypeId
json_path = CodeBlock { jsonPath = "C:/PluginRevit/Data/Config/inclinacao_input.json"; }  # graph input
parseJSON = Data.ParseJSON(filePath=json_path)
extrair_campos = CodeBlock(data=parseJSON)
# ---------- extrair_campos.designscript (5 lines) ----------
pipeIds = data["pipes"];
slopePercent = data["slopePercent"];
baseZMode = data["baseZMode"];
tolerance = data["tolerance"];
systemTypeId = data["systemTypeId"];
# ----------------------------------------

# group: 2. APLICAÇÃO DE INCLINAÇÃO
# Python: LocationCurve → calcula drop → Line.CreateBound → loc.Curve = new_line → RBS_PIPE_SLOPE
python_aplicar_inclinação = Python(IN[0]=extrair_campos.pipeIds, IN[1]=extrair_campos.slopePercent, IN[2]=extrair_campos.baseZMode, IN[3]=extrair_campos.tolerance, IN[4]=extrair_campos.systemTypeId)  # CPython3
# ---------- python_aplicar_inclinação.python (153 lines) ----------
import clr
clr.AddReference('RevitAPI')
clr.AddReference('RevitServices')
from Autodesk.Revit.DB import *
from RevitServices.Persistence import DocumentManager
from RevitServices.Transactions import TransactionManager
import json
import math
import time
from datetime import datetime

start_time = time.time()
doc = DocumentManager.Instance.CurrentDBDocument

pipe_ids = IN[0] if isinstance(IN[0], list) else [IN[0]]
slope_pct = float(IN[1])
base_z_mode = str(IN[2]).lower() if IN[2] else "auto"
tol = float(IN[3]) if IN[3] else 0.005
sys_type_id = int(IN[4]) if IN[4] else -1

updated_pipes = []
slopes_applied = []
failed = []
before_after = []

TransactionManager.Instance.EnsureInTransaction(doc)

for pid in pipe_ids:
    try:
        eid = ElementId(int(pid))
        pipe = doc.GetElement(eid)
        if pipe is None:
            failed.append({"pipeId": int(pid), "error": "Element not found"})
            continue
        
        loc = pipe.Location
        if not isinstance(loc, LocationCurve):
            failed.append({"pipeId": int(pid), "error": "No LocationCurve"})
            continue
        
        curve = loc.Curve
        p1 = curve.GetEndPoint(0)
        p2 = curve.GetEndPoint(1)
        
        dx = p2.X - p1.X
        dy = p2.Y - p1.Y
        horiz_dist = math.sqrt(dx*dx + dy*dy)
        
        if horiz_dist < 0.001:
            failed.append({"pipeId": int(pid), "error": "Vertical pipe, skip"})
            continue
        
        drop = horiz_dist * (slope_pct / 100.0)
        
        old_slope = abs(p1.Z - p2.Z) / horiz_dist * 100.0 if horiz_dist > 0 else 0
        
        if base_z_mode == "start":
            new_z1 = p1.Z
            new_z2 = p1.Z - drop
        elif base_z_mode == "end":
            new_z1 = p2.Z + drop
            new_z2 = p2.Z
        else:
            if p1.Z >= p2.Z:
                new_z1 = p1.Z
                new_z2 = p1.Z - drop
            else:
                new_z1 = p2.Z + drop
                new_z2 = p2.Z
        
        new_p1 = XYZ(p1.X, p1.Y, new_z1)
        new_p2 = XYZ(p2.X, p2.Y, new_z2)
        
        new_line = Line.CreateBound(new_p1, new_p2)
        loc.Curve = new_line
        
        slope_param = pipe.get_Parameter(BuiltInParameter.RBS_PIPE_SLOPE)
        if slope_param and not slope_param.IsReadOnly:
            slope_param.Set(slope_pct / 100.0)
        
        actual_dz = abs(new_z1 - new_z2)
        actual_slope = (actual_dz / horiz_dist) * 100.0 if horiz_dist > 0 else 0
        
        updated_pipes.append(int(pid))
        slopes_applied.append(round(actual_slope, 4))
        
        before_after.append({
            "pipeId": int(pid),
            "oldSlope": round(old_slope, 4),
            "newSlope": round(actual_slope, 4),
            "drop_ft": round(float(drop), 4),
            "horizDist_ft": round(float(horiz_dist), 4),
            "startZ": round(float(new_z1), 4),
            "endZ": round(float(new_z2), 4)
        })
        
    except Exception as e:
        failed.append({"pipeId": int(pid) if pid else -1, "error": str(e)})

all_ok = True
slope_errors = []
min_slope = slope_pct * (1.0 - tol)
for i, sl in enumerate(slopes_applied):
    if sl < min_slope:
        all_ok = False
        slope_errors.append({
            "pipeId": updated_pipes[i],
            "appliedSlope": sl,
            "minRequired": round(min_slope, 4)
        })

TransactionManager.Instance.TransactionTaskDone()

end_time = time.time()
avg_slope = sum(slopes_applied) / len(slopes_applied) if slopes_applied else 0

if not all_ok:
    status = "ERRO_INCLINACAO"
elif len(failed) > 0 and len(updated_pipes) > 0:
    status = "PARCIAL"
elif len(failed) > 0 and len(updated_pipes) == 0:
    status = "FALHA_TOTAL"
else:
    status = "OK"

result = {
    "success": status == "OK",
    "updatedPipes": updated_pipes,
    "slopesApplied": slopes_applied,
    "avgSlope": round(avg_slope, 4),
    "targetSlope": slope_pct,
    "baseZMode": base_z_mode,
    "count": len(updated_pipes),
    "failed": failed,
    "failedCount": len(failed),
    "slopeErrors": slope_errors,
    "details": before_after,
    "status": status,
    "executionTimeMs": int((end_time - start_time) * 1000),
    "timestamp": datetime.utcnow().isoformat() + "Z"
}

json_str = json.dumps(result, indent=2)
statuses_list = []
for ba in before_after:
    old = ba["oldSlope"]
    new = ba["newSlope"]
    if new >= min_slope:
        statuses_list.append("OK")
    else:
        statuses_list.append("ERRO")

OUT = [json_str, updated_pipes, slopes_applied, statuses_list, status, before_after]
# ----------------------------------------
separar_resultados = CodeBlock(pyOut=python_aplicar_inclinação)
# ---------- separar_resultados.designscript (6 lines) ----------
jsonResult = pyOut[0];
pipeIds = pyOut[1];
slopesApplied = pyOut[2];
statuses = pyOut[3];
overallStatus = pyOut[4];
details = pyOut[5];
# ----------------------------------------

# group: 3. SAÍDAS
# Tabela resumo, status geral, detalhes before/after e JSON completo
montar_tabela = CodeBlock(pipeIds=separar_resultados.pipeIds, slopes=separar_resultados.slopesApplied, statuses=separar_resultados.statuses)
# ---------- montar_tabela.designscript (3 lines) ----------
headers = {"PipeId", "Slope %", "Status"};
rows = List.Transpose({pipeIds, slopes, statuses});
table = List.AddItemToFront(headers, rows);
# ----------------------------------------
watch_tabela_resumo = Watch(montar_tabela)  # graph output
watch_status_geral = Watch(separar_resultados.overallStatus)  # graph output
watch_detalhes = Watch(separar_resultados.details)  # graph output
watch_out_json = Watch(separar_resultados.jsonResult)  # graph output
