# Dynamo graph 08_CriarPrumadas.dyn (Dynamo 3.0.0.0)
# author: Murillo Santtos
# Criação automática de prumadas verticais MEP - conecta níveis com Pipes verticais contínuos
# packages: DynamoCore 3.0.0.0, CoreNodeModels 3.0.0.0, PythonNodeModels 3.0.0.0

# group: 1. ENTRADA JSON
# Lê originPoints[], levels[], pipeTypeId, systemTypeId, diameterMm, offsets, tolerance, connectToExisting
json_path = CodeBlock { jsonPath = "C:/PluginRevit/Data/Config/prumadas_input.json"; }  # graph input
parseJSON = Data.ParseJSON(filePath=json_path)
extrair_campos_json = CodeBlock(data=parseJSON)
# ---------- extrair_campos_json.designscript (10 lines) ----------
pts = data["originPoints"];
originPts = List.Map(pts, Function(p) { return Autodesk.DesignScript.Geometry.Point.ByCoordinates(p["x"], p["y"], p["z"]); });
levelNames = data["levels"];
pipeTypeId = data["pipeTypeId"];
systemTypeId = data["systemTypeId"];
diameterMm = data["diameterMm"];
offsetX = data["offsetX"];
offsetY = data["offsetY"];
tolerance = data["tolerance"];
connectExisting = data["connectToExisting"];
# ----------------------------------------

# group: 2. CRIAÇÃO DE PRUMADAS
# Para cada origin: ordena levels por elevation, cria Pipe vertical entre levels consecutivos, conecta segmentos
python_criar_prumadas = Python(IN[0]=extrair_campos_json.out0, IN[1]=extrair_campos_json.out1, IN[2]=extrair_campos_json.out2, IN[3]=extrair_campos_json.out3, IN[4]=extrair_campos_json.out4, IN[5]=extrair_campos_json.out5, IN[6]=extrair_campos_json.out6, IN[7]=extrair_campos_json.out7, IN[8]=extrair_campos_json.out8)  # CPython3
# ---------- python_criar_prumadas.python (194 lines) ----------
import clr
clr.AddReference('RevitAPI')
clr.AddReference('RevitServices')
from Autodesk.Revit.DB import *
from Autodesk.Revit.DB.Plumbing import Pipe
from RevitServices.Persistence import DocumentManager
from RevitServices.Transactions import TransactionManager
import json
import math
import time
from datetime import datetime

start_time = time.time()
doc = DocumentManager.Instance.CurrentDBDocument

origin_pts = IN[0] if isinstance(IN[0], list) else [IN[0]]
level_names = IN[1] if isinstance(IN[1], list) else [IN[1]]
pipe_type_id = int(IN[2])
system_type_id = int(IN[3])
diameter_mm = float(IN[4])
offset_x_mm = float(IN[5]) if IN[5] else 0
offset_y_mm = float(IN[6]) if IN[6] else 0
tolerance = float(IN[7]) if IN[7] else 0.01
connect_existing = bool(IN[8]) if IN[8] else False

diameter_ft = diameter_mm / 304.8
offset_x_ft = offset_x_mm / 304.8
offset_y_ft = offset_y_mm / 304.8

pipe_type_eid = ElementId(pipe_type_id)
system_type_eid = ElementId(system_type_id)

all_levels = FilteredElementCollector(doc).OfClass(Level).ToElements()
level_map = {}
for lvl in all_levels:
    level_map[lvl.Name] = lvl

sorted_levels = []
for ln in level_names:
    if ln in level_map:
        sorted_levels.append(level_map[ln])

sorted_levels.sort(key=lambda l: l.Elevation)

if len(sorted_levels) < 2:
    OUT = [json.dumps({"success": False, "status": "ERRO_LEVELS", "message": "Need at least 2 levels"}), [], "ERRO_LEVELS", []]
else:
    created_pipes = []
    failed = []
    pipe_elements = []
    prumada_details = []
    total_height = 0
    levels_used = [l.Name for l in sorted_levels]
    
    TransactionManager.Instance.EnsureInTransaction(doc)
    
    for origin in origin_pts:
        try:
            ox = origin.X / 304.8 + offset_x_ft
            oy = origin.Y / 304.8 + offset_y_ft
        except:
            ox = 0
            oy = 0
        
        prumada_pipes = []
        
        for i in range(len(sorted_levels) - 1):
            try:
                z1 = sorted_levels[i].Elevation
                z2 = sorted_levels[i + 1].Elevation
                
                if abs(z2 - z1) < 0.01:
                    continue
                
                p1 = XYZ(ox, oy, z1)
                p2 = XYZ(ox, oy, z2)
                
                base_level = sorted_levels[i]
                
                pipe = Pipe.Create(doc, system_type_eid, pipe_type_eid, base_level.Id, p1, p2)
                
                param_diam = pipe.get_Parameter(BuiltInParameter.RBS_PIPE_DIAMETER_PARAM)
                if param_diam and not param_diam.IsReadOnly:
                    param_diam.Set(diameter_ft)
                
                seg_height = abs(z2 - z1)
                total_height += seg_height
                
                created_pipes.append(pipe.Id.IntegerValue)
                pipe_elements.append(pipe)
                prumada_pipes.append(pipe)
                
                prumada_details.append({
                    "pipeId": pipe.Id.IntegerValue,
                    "fromLevel": sorted_levels[i].Name,
                    "toLevel": sorted_levels[i + 1].Name,
                    "height_ft": round(float(seg_height), 4),
                    "height_m": round(float(seg_height * 0.3048), 4),
                    "x_ft": round(float(ox), 4),
                    "y_ft": round(float(oy), 4)
                })
            except Exception as e:
                failed.append({
                    "fromLevel": sorted_levels[i].Name if i < len(sorted_levels) else "?",
                    "toLevel": sorted_levels[i+1].Name if i+1 < len(sorted_levels) else "?",
                    "error": str(e)
                })
        
        for i in range(len(prumada_pipes) - 1):
            try:
                c1 = prumada_pipes[i].ConnectorManager.Connectors
                c2 = prumada_pipes[i + 1].ConnectorManager.Connectors
                best_dist = float('inf')
                best_pair = None
                for conn1 in c1:
                    for conn2 in c2:
                        d = conn1.Origin.DistanceTo(conn2.Origin)
                        if d < best_dist:
                            best_dist = d
                            best_pair = (conn1, conn2)
                if best_pair and best_dist < tolerance:
                    if not best_pair[0].IsConnected and not best_pair[1].IsConnected:
                        best_pair[0].ConnectTo(best_pair[1])
            except:
                pass
        
        if connect_existing:
            try:
                fec = FilteredElementCollector(doc)
                fec.OfClass(type(pipe_elements[0])) if pipe_elements else None
                nearby = fec.ToElements() if pipe_elements else []
                for ep in pipe_elements:
                    ec = ep.ConnectorManager.Connectors
                    for conn in ec:
                        if conn.IsConnected:
                            continue
                        for other in nearby:
                            if other.Id == ep.Id:
                                continue
                            try:
                                oc = other.ConnectorManager.Connectors
                                for oconn in oc:
                                    if oconn.IsConnected:
                                        continue
                                    d = conn.Origin.DistanceTo(oconn.Origin)
                                    if d < tolerance:
                                        conn.ConnectTo(oconn)
                                        break
                            except:
                                continue
            except:
                pass
    
    alignment_ok = True
    for det in prumada_details:
        if len(prumada_details) > 1:
            ref_x = prumada_details[0]["x_ft"]
            ref_y = prumada_details[0]["y_ft"]
            if abs(det["x_ft"] - ref_x) > tolerance or abs(det["y_ft"] - ref_y) > tolerance:
                alignment_ok = False
                break
    
    TransactionManager.Instance.TransactionTaskDone()
    
    end_time = time.time()
    
    if not alignment_ok:
        status = "ERRO_DESALINHAMENTO"
    elif len(failed) > 0 and len(created_pipes) > 0:
        status = "PARCIAL"
    elif len(failed) > 0 and len(created_pipes) == 0:
        status = "FALHA_TOTAL"
    else:
        status = "OK"
    
    result = {
        "success": status == "OK",
        "pipesCreated": created_pipes,
        "segmentCount": len(created_pipes),
        "totalHeight_ft": round(float(total_height), 4),
        "totalHeight_m": round(float(total_height * 0.3048), 4),
        "levelsUsed": levels_used,
        "levelCount": len(sorted_levels),
        "diameter_mm": diameter_mm,
        "details": prumada_details,
        "failed": failed,
        "failedCount": len(failed),
        "alignmentValid": alignment_ok,
        "status": status,
        "executionTimeMs": int((end_time - start_time) * 1000),
        "timestamp": datetime.utcnow().isoformat() + "Z"
    }
    
    OUT = [json.dumps(result, indent=2), created_pipes, status, prumada_details]
# ----------------------------------------
separar_resultados = CodeBlock(pyOut=python_criar_prumadas) { jsonResult = pyOut[0]; pipeIds = pyOut[1]; status = pyOut[2]; details = pyOut[3]; }

# group: 3. SAÍDAS
# Pipe IDs, Status, Detalhes por segmento (Level→Level, altura) e JSON completo
watch_pipe_ids = Watch(separar_resultados.pipeIds)  # graph output
watch_status = Watch(separar_resultados.status)  # graph output
watch_detalhes_segmentos = Watch(separar_resultados.details)  # graph output
watch_out_json = Watch(separar_resultados.jsonResult)  # graph output
