# Dynamo graph 09_ConectarRede.dyn (Dynamo 3.0.0.0)
# author: Murillo Santtos
# Interconexão automática de trechos de tubulação MEP - ramais, prumadas, fixtures via ConnectorManager
# packages: DynamoCore 3.0.0.0, CoreNodeModels 3.0.0.0, PythonNodeModels 3.0.0.0

# group: 1. ENTRADA JSON
# elements[], maxDistance, tolerance, autoAlign, autoRotate, expectedSystemTypeId, minZ, maxZ
json_path = CodeBlock { jsonPath = "C:/PluginRevit/Data/Config/conectar_rede_input.json"; }  # graph input
parseJSON = Data.ParseJSON(filePath=json_path)
extrair_campos_json = CodeBlock(data=parseJSON)
# ---------- extrair_campos_json.designscript (8 lines) ----------
elementIds = data["elements"];
maxDistance = data["maxDistance"];
tolerance = data["tolerance"];
autoAlign = data["autoAlign"];
autoRotate = data["autoRotate"];
expectedSysId = data["expectedSystemTypeId"];
minZ = data["minZ"];
maxZ = data["maxZ"];
# ----------------------------------------

# group: 2. DETECÇÃO E CONEXÃO
# Extrai ConnectorManager de Pipes/Fittings/Fixtures, encontra pares por distância+domínio, auto-align, auto-rotate, ConnectTo
python_conectar_rede = Python(IN[0]=extrair_campos_json.elementIds, IN[1]=extrair_campos_json.maxDistance, IN[2]=extrair_campos_json.tolerance, IN[3]=extrair_campos_json.autoAlign, IN[4]=extrair_campos_json.autoRotate, IN[5]=extrair_campos_json.expectedSysId, IN[6]=extrair_campos_json.minZ, IN[7]=extrair_campos_json.maxZ)  # CPython3
# ---------- python_conectar_rede.python (193 lines) ----------
import clr
clr.AddReference('RevitAPI')
clr.AddReference('RevitServices')
from Autodesk.Revit.DB import *
from RevitServices.Persistence import DocumentManager
from RevitServices.Transactions import TransactionManager
import json
import math
import time
from datetime import datetime

start_time = time.time()
doc = DocumentManager.Instance.CurrentDBDocument

element_ids = IN[0] if isinstance(IN[0], list) else [IN[0]]
max_dist_mm = float(IN[1]) if IN[1] else 50
tol = float(IN[2]) if IN[2] else 0.005
auto_align = bool(IN[3]) if IN[3] is not None else False
auto_rotate = bool(IN[4]) if IN[4] is not None else False
expected_sys_id = int(IN[5]) if IN[5] else -1
min_z = float(IN[6]) / 304.8 if IN[6] is not None else -1e9
max_z = float(IN[7]) / 304.8 if IN[7] is not None else 1e9

max_dist_ft = max_dist_mm / 304.8

elements = []
for eid in element_ids:
    try:
        el = doc.GetElement(ElementId(int(eid)))
        if el is not None:
            elements.append(el)
    except:
        continue

all_connectors = []
for el in elements:
    try:
        cm = None
        if hasattr(el, 'ConnectorManager'):
            cm = el.ConnectorManager
        elif hasattr(el, 'MEPModel') and el.MEPModel is not None:
            cm = el.MEPModel.ConnectorManager
        if cm is None:
            continue
        for conn in cm.Connectors:
            z = conn.Origin.Z
            if z >= min_z and z <= max_z:
                all_connectors.append(conn)
    except:
        continue

pairs = []
for i in range(len(all_connectors)):
    c1 = all_connectors[i]
    if c1.IsConnected:
        continue
    for j in range(i + 1, len(all_connectors)):
        c2 = all_connectors[j]
        if c2.IsConnected:
            continue
        if c1.Owner.Id == c2.Owner.Id:
            continue
        dist = c1.Origin.DistanceTo(c2.Origin)
        if dist <= max_dist_ft:
            if c1.Domain == c2.Domain:
                pairs.append((c1, c2, dist))

pairs.sort(key=lambda x: x[2])

connections = []
skipped = []
errors = []
connected_set = set()

TransactionManager.Instance.EnsureInTransaction(doc)

for c1, c2, dist in pairs:
    c1_key = (c1.Owner.Id.IntegerValue, c1.Id)
    c2_key = (c2.Owner.Id.IntegerValue, c2.Id)
    
    if c1_key in connected_set or c2_key in connected_set:
        skipped.append({
            "elem1": c1.Owner.Id.IntegerValue,
            "elem2": c2.Owner.Id.IntegerValue,
            "reason": "Already connected in this run"
        })
        continue
    
    if c1.IsConnected or c2.IsConnected:
        skipped.append({
            "elem1": c1.Owner.Id.IntegerValue,
            "elem2": c2.Owner.Id.IntegerValue,
            "reason": "Connector already in use"
        })
        continue
    
    try:
        if auto_align and dist > tol:
            owner1 = c1.Owner
            if isinstance(owner1.Location, LocationCurve):
                curve = owner1.Location.Curve
                p0 = curve.GetEndPoint(0)
                p1_end = curve.GetEndPoint(1)
                
                d0 = c1.Origin.DistanceTo(p0)
                d1 = c1.Origin.DistanceTo(p1_end)
                
                target = c2.Origin
                
                if d0 < d1:
                    new_p0 = target
                    new_line = Line.CreateBound(new_p0, p1_end)
                    if new_line.Length > 0.01:
                        owner1.Location.Curve = new_line
                else:
                    new_p1 = target
                    new_line = Line.CreateBound(p0, new_p1)
                    if new_line.Length > 0.01:
                        owner1.Location.Curve = new_line
    except:
        pass
    
    try:
        if auto_rotate:
            owner2 = c2.Owner
            if hasattr(owner2, 'Location') and hasattr(owner2.Location, 'Point'):
                pt = owner2.Location.Point
                dir1 = c1.CoordinateSystem.BasisZ
                dir2 = c2.CoordinateSystem.BasisZ
                
                dot = dir1.X * (-dir2.X) + dir1.Y * (-dir2.Y)
                if abs(dot - 1.0) > 0.01:
                    angle = math.atan2(dir1.Y, dir1.X) - math.atan2(-dir2.Y, -dir2.X)
                    if abs(angle) > 0.01:
                        axis = Line.CreateBound(pt, XYZ(pt.X, pt.Y, pt.Z + 1))
                        ElementTransformUtils.RotateElement(doc, owner2.Id, axis, angle)
    except:
        pass
    
    try:
        c1.ConnectTo(c2)
        connections.append({
            "elem1": c1.Owner.Id.IntegerValue,
            "elem2": c2.Owner.Id.IntegerValue,
            "distance_mm": round(float(dist * 304.8), 2),
            "connType": str(c1.Domain)
        })
        connected_set.add(c1_key)
        connected_set.add(c2_key)
    except Exception as e:
        errors.append({
            "elem1": c1.Owner.Id.IntegerValue,
            "elem2": c2.Owner.Id.IntegerValue,
            "distance_mm": round(float(dist * 304.8), 2),
            "error": str(e)
        })

TransactionManager.Instance.TransactionTaskDone()

end_time = time.time()

if len(connections) == 0 and len(errors) == 0:
    status = "NENHUMA_CONEXAO_REALIZADA"
elif len(connections) == 0 and len(errors) > 0:
    status = "FALHA_TOTAL"
elif len(errors) > 0:
    status = "PARCIAL"
else:
    status = "OK"

result = {
    "success": status == "OK",
    "connections": connections,
    "connectedCount": len(connections),
    "skipped": skipped,
    "skippedCount": len(skipped),
    "errors": errors,
    "errorCount": len(errors),
    "attemptedPairs": len(pairs),
    "totalConnectorsScanned": len(all_connectors),
    "totalElements": len(elements),
    "maxDistance_mm": max_dist_mm,
    "autoAlign": auto_align,
    "autoRotate": auto_rotate,
    "status": status,
    "executionTimeMs": int((end_time - start_time) * 1000),
    "timestamp": datetime.utcnow().isoformat() + "Z"
}

conn_ids = [(c["elem1"], c["elem2"]) for c in connections]
err_ids = [(e["elem1"], e["elem2"]) for e in errors]

OUT = [json.dumps(result, indent=2), conn_ids, err_ids, status, connections, skipped]
# ----------------------------------------
separar_resultados = CodeBlock(pyOut=python_conectar_rede)
# ---------- separar_resultados.designscript (6 lines) ----------
jsonResult = pyOut[0];
connPairs = pyOut[1];
errPairs = pyOut[2];
status = pyOut[3];
connections = pyOut[4];
skipped = pyOut[5];
# ----------------------------------------

# group: 3. SAÍDAS
# Conexões realizadas, status, erros, skipped e JSON completo de retorno
watch_conexões_realizadas = Watch(separar_resultados.connPairs)  # graph output
watch_status = Watch(separar_resultados.status)  # graph output
watch_erros = Watch(separar_resultados.errPairs)  # graph output
watch_skipped = Watch(separar_resultados.skipped)  # graph output
watch_out_json = Watch(separar_resultados.jsonResult)  # graph output
