# Dynamo graph 10_GerarTabelas.dyn (Dynamo 3.0.0.0)
# author: Murillo Santtos
# Criação automática de Schedules MEP - Tubulação, Conexões e Equipamentos com campos, filtros e formatação
# packages: DynamoCore 3.0.0.0, CoreNodeModels 3.0.0.0, PythonNodeModels 3.0.0.0

# group: 1. CONFIGURAÇÃO
# Lê projectName, flags de criação, listas de campos, opções de formatação/filtro/sorting
json_path = CodeBlock { jsonPath = "C:/PluginRevit/Data/Config/tabelas_input.json"; }  # graph input
parseJSON = Data.ParseJSON(filePath=json_path)
extrair_configurações = CodeBlock(data=parseJSON)
# ---------- extrair_configurações.designscript (10 lines) ----------
projectName = data["projectName"];
createPipes = data["createPipesSchedule"];
createFittings = data["createFittingsSchedule"];
createFixtures = data["createFixturesSchedule"];
fieldsPipes = data["fieldsPipes"];
fieldsFittings = data["fieldsFittings"];
fieldsFixtures = data["fieldsFixtures"];
applyFormatting = data["applyFormatting"];
applyFilters = data["applyFilters"];
applySorting = data["applySorting"];
# ----------------------------------------

# group: 2. CRIAÇÃO DE SCHEDULES
# ViewSchedule.CreateSchedule → AddField → Filtros → SortGroup → Formatação (IsItemized, ShowHeaders, GridColumnWidth)
python_criar_atualizar_schedules = Python(IN[0]=extrair_configurações.projectName, IN[1]=extrair_configurações.createPipes, IN[2]=extrair_configurações.createFittings, IN[3]=extrair_configurações.createFixtures, IN[4]=extrair_configurações.fieldsPipes, IN[5]=extrair_configurações.fieldsFittings, IN[6]=extrair_configurações.fieldsFixtures, IN[7]=extrair_configurações.applyFormatting, IN[8]=extrair_configurações.applyFilters, IN[9]=extrair_configurações.applySorting)  # CPython3
# ---------- python_criar_atualizar_schedules.python (239 lines) ----------
import clr
clr.AddReference('RevitAPI')
clr.AddReference('RevitServices')
from Autodesk.Revit.DB import *
from RevitServices.Persistence import DocumentManager
from RevitServices.Transactions import TransactionManager
import json
import time
from datetime import datetime

start_time = time.time()
doc = DocumentManager.Instance.CurrentDBDocument

project_name = str(IN[0]) if IN[0] else "Projeto"
create_pipes = bool(IN[1]) if IN[1] is not None else True
create_fittings = bool(IN[2]) if IN[2] is not None else True
create_fixtures = bool(IN[3]) if IN[3] is not None else True
fields_pipes = IN[4] if isinstance(IN[4], list) else []
fields_fittings = IN[5] if isinstance(IN[5], list) else []
fields_fixtures = IN[6] if isinstance(IN[6], list) else []
apply_formatting = bool(IN[7]) if IN[7] is not None else True
apply_filters = bool(IN[8]) if IN[8] is not None else True
apply_sorting = bool(IN[9]) if IN[9] is not None else True

existing_schedules = {}
fec = FilteredElementCollector(doc).OfClass(ViewSchedule)
for vs in fec:
    existing_schedules[vs.Name] = vs

category_map = {
    "Pipes": BuiltInCategory.OST_PipeCurves,
    "PipeFittings": BuiltInCategory.OST_PipeFitting,
    "PlumbingFixtures": BuiltInCategory.OST_PlumbingFixtures
}

def find_schedulable_field(definition, field_name):
    schedulable = definition.GetSchedulableFields()
    for sf in schedulable:
        try:
            if sf.GetName(doc) == field_name:
                return sf
        except:
            pass
    for sf in schedulable:
        try:
            name = sf.GetName(doc)
            if name and name.lower() == field_name.lower():
                return sf
        except:
            pass
    return None

def add_fields_to_schedule(schedule, field_names):
    definition = schedule.Definition
    added = []
    skipped = []
    
    existing_field_ids = definition.GetFieldOrder()
    existing_names = []
    for fid in existing_field_ids:
        try:
            f = definition.GetField(fid)
            existing_names.append(f.GetName())
        except:
            pass
    
    for fn in field_names:
        if fn in existing_names:
            skipped.append(fn)
            continue
        sf = find_schedulable_field(definition, fn)
        if sf is not None:
            try:
                definition.AddField(sf)
                added.append(fn)
            except:
                skipped.append(fn)
        else:
            skipped.append(fn)
    return added, skipped

def apply_schedule_filters(schedule, cat_key):
    definition = schedule.Definition
    field_order = definition.GetFieldOrder()
    
    if cat_key == "Pipes":
        for fid in field_order:
            try:
                field = definition.GetField(fid)
                if field.GetName().lower() in ["length", "comprimento"]:
                    sf = ScheduleFilter(fid, ScheduleFilterType.GreaterThan, 0.0)
                    definition.AddFilter(sf)
                    break
            except:
                pass

def apply_schedule_sorting(schedule, cat_key):
    definition = schedule.Definition
    field_order = definition.GetFieldOrder()
    
    sort_field_names = {
        "Pipes": ["System Type", "Size", "Length"],
        "PipeFittings": ["System Type", "Family and Type"],
        "PlumbingFixtures": ["Family and Type", "Level"]
    }
    
    targets = sort_field_names.get(cat_key, [])
    for target in targets:
        for fid in field_order:
            try:
                field = definition.GetField(fid)
                if field.GetName().lower() == target.lower():
                    sgf = ScheduleSortGroupField(fid)
                    sgf.ShowHeader = True
                    sgf.ShowFooter = False
                    definition.AddSortGroupField(sgf)
                    break
            except:
                pass

def apply_schedule_formatting(schedule, cat_key):
    definition = schedule.Definition
    
    definition.IsItemized = True
    definition.ShowHeaders = True
    
    if cat_key == "PlumbingFixtures":
        definition.ShowGrandTotal = True
        definition.ShowGrandTotalTitle = True
        definition.ShowGrandTotalCount = True
    else:
        definition.ShowGrandTotal = False
    
    field_order = definition.GetFieldOrder()
    for fid in field_order:
        try:
            field = definition.GetField(fid)
            opts = field.GetFormatOptions()
            if field.GetStyle() is not None:
                pass
            field.GridColumnWidth = max(field.GridColumnWidth, 10)
        except:
            pass

created_schedules = []
updated_schedules = []
errors = []
schedule_ids = []

tasks = []
if create_pipes:
    tasks.append(("Pipes", "QT \u2013 Tubula\u00e7\u00e3o \u2013 " + project_name, fields_pipes))
if create_fittings:
    tasks.append(("PipeFittings", "QT \u2013 Conex\u00f5es \u2013 " + project_name, fields_fittings))
if create_fixtures:
    tasks.append(("PlumbingFixtures", "QT \u2013 Equipamentos \u2013 " + project_name, fields_fixtures))

TransactionManager.Instance.EnsureInTransaction(doc)

for cat_key, sched_name, field_list in tasks:
    try:
        bic = category_map[cat_key]
        cat_id = ElementId(bic)
        
        is_new = False
        if sched_name in existing_schedules:
            schedule = existing_schedules[sched_name]
        else:
            schedule = ViewSchedule.CreateSchedule(doc, cat_id)
            schedule.Name = sched_name
            is_new = True
        
        added, skipped = add_fields_to_schedule(schedule, field_list)
        
        if apply_filters:
            try:
                apply_schedule_filters(schedule, cat_key)
            except:
                pass
        
        if apply_sorting:
            try:
                apply_schedule_sorting(schedule, cat_key)
            except:
                pass
        
        if apply_formatting:
            try:
                apply_schedule_formatting(schedule, cat_key)
            except:
                pass
        
        entry = {
            "name": sched_name,
            "scheduleId": schedule.Id.IntegerValue,
            "category": cat_key,
            "fieldsAdded": added,
            "fieldsSkipped": skipped
        }
        
        if is_new:
            created_schedules.append(entry)
        else:
            updated_schedules.append(entry)
        
        schedule_ids.append(schedule.Id.IntegerValue)
    except Exception as e:
        errors.append({
            "category": cat_key,
            "scheduleName": sched_name,
            "error": str(e)
        })

TransactionManager.Instance.TransactionTaskDone()

end_time = time.time()

if len(created_schedules) + len(updated_schedules) == 0:
    status = "EMPTY"
elif len(errors) > 0:
    status = "PARCIAL"
else:
    status = "OK"

result = {
    "success": status == "OK",
    "schedulesCreated": created_schedules,
    "createdCount": len(created_schedules),
    "schedulesUpdated": updated_schedules,
    "updatedCount": len(updated_schedules),
    "scheduleIds": schedule_ids,
    "errors": errors,
    "errorCount": len(errors),
    "status": status,
    "executionTimeMs": int((end_time - start_time) * 1000),
    "timestamp": datetime.utcnow().isoformat() + "Z"
}

OUT = [json.dumps(result, indent=2), schedule_ids, status, created_schedules, updated_schedules, errors]
# ----------------------------------------
separar_resultados = CodeBlock(pyOut=python_criar_atualizar_schedules)
# ---------- separar_resultados.designscript (6 lines) ----------
jsonResult = pyOut[0];
scheduleIds = pyOut[1];
status = pyOut[2];
created = pyOut[3];
updated = pyOut[4];
errors = pyOut[5];
# ----------------------------------------

# group: 3. SAÍDAS
# Schedule IDs, Status, Criados, Atualizados e JSON completo
watch_schedule_ids = Watch(separar_resultados.scheduleIds)  # graph output
watch_status = Watch(separar_resultados.status)  # graph output
watch_criados = Watch(separar_resultados.created)  # graph output
watch_atualizados = Watch(separar_resultados.updated)  # graph output
watch_out_json = Watch(separar_resultados.jsonResult)  # graph output
