# Dynamo graph 11_GerarPranchas.dyn (Dynamo 3.0.0.0)
# author: Murillo Santtos
# Montagem automática de pranchas - ViewSheet, Viewport, ScheduleSheetInstance, TextNote com numeração sequencial
# packages: DynamoCore 3.0.0.0, CoreNodeModels 3.0.0.0, PythonNodeModels 3.0.0.0

# group: 1. CONFIGURAÇÃO
# projectName, titleBlockName, viewPrefix, tableNames[], legendNames[], noteText, sheetStartNumber, flags, posConfig
json_path = CodeBlock { jsonPath = "C:/PluginRevit/Data/Config/pranchas_input.json"; }  # graph input
parseJSON = Data.ParseJSON(filePath=json_path)
extrair_configuração = CodeBlock(data=parseJSON)
# ---------- extrair_configuração.designscript (11 lines) ----------
projectName = data["projectName"];
titleBlockName = data["titleBlockName"];
viewPrefix = data["viewPrefix"];
tableNames = data["tableNames"];
legendNames = data["legendNames"];
noteText = data["noteText"];
startNumber = data["sheetStartNumber"];
autoArrange = data["autoArrangeViews"];
autoTables = data["autoInsertTables"];
autoLegends = data["autoInsertLegends"];
posConfig = data["templatePositionConfig"];
# ----------------------------------------

# group: 2. MONTAGEM DE PRANCHAS
# ViewSheet.Create → Viewport.Create → ScheduleSheetInstance.Create → TextNote.Create, numeração PR-<proj>-NN
python_gerar_pranchas = Python(IN[0]=extrair_configuração.projectName, IN[1]=extrair_configuração.titleBlockName, IN[2]=extrair_configuração.viewPrefix, IN[3]=extrair_configuração.tableNames, IN[4]=extrair_configuração.legendNames, IN[5]=extrair_configuração.noteText, IN[6]=extrair_configuração.startNumber, IN[7]=extrair_configuração.autoArrange, IN[8]=extrair_configuração.autoTables, IN[9]=extrair_configuração.autoLegends, IN[10]=extrair_configuração.posConfig)  # CPython3
# ---------- python_gerar_pranchas.python (217 lines) ----------
import clr
clr.AddReference('RevitAPI')
clr.AddReference('RevitServices')
from Autodesk.Revit.DB import *
from RevitServices.Persistence import DocumentManager
from RevitServices.Transactions import TransactionManager
import json
import time
from datetime import datetime

start_time = time.time()
doc = DocumentManager.Instance.CurrentDBDocument

project_name = str(IN[0]) if IN[0] else "Projeto"
tb_name = str(IN[1]) if IN[1] else ""
view_prefix = str(IN[2]) if IN[2] else "HID"
table_names = IN[3] if isinstance(IN[3], list) else []
legend_names = IN[4] if isinstance(IN[4], list) else []
note_text = str(IN[5]) if IN[5] else ""
start_num = int(IN[6]) if IN[6] else 1
auto_arrange = bool(IN[7]) if IN[7] is not None else True
auto_tables = bool(IN[8]) if IN[8] is not None else True
auto_legends = bool(IN[9]) if IN[9] is not None else True
pos_cfg = IN[10] if IN[10] else {}

vw_pos = pos_cfg.get("views", {"x": 0.2, "y": 0.7}) if isinstance(pos_cfg, dict) else {"x": 0.2, "y": 0.7}
tb_pos = pos_cfg.get("tables", {"x": 0.2, "y": 0.25}) if isinstance(pos_cfg, dict) else {"x": 0.2, "y": 0.25}
lg_pos = pos_cfg.get("legends", {"x": 0.75, "y": 0.7}) if isinstance(pos_cfg, dict) else {"x": 0.75, "y": 0.7}

vw_x = float(vw_pos.get("x", 0.2)) / 0.3048 if isinstance(vw_pos, dict) else 0.656
vw_y = float(vw_pos.get("y", 0.7)) / 0.3048 if isinstance(vw_pos, dict) else 2.297
tb_x = float(tb_pos.get("x", 0.2)) / 0.3048 if isinstance(tb_pos, dict) else 0.656
tb_y = float(tb_pos.get("y", 0.25)) / 0.3048 if isinstance(tb_pos, dict) else 0.820
lg_x = float(lg_pos.get("x", 0.75)) / 0.3048 if isinstance(lg_pos, dict) else 2.461
lg_y = float(lg_pos.get("y", 0.7)) / 0.3048 if isinstance(lg_pos, dict) else 2.297

title_block = None
tb_collector = FilteredElementCollector(doc).OfClass(FamilySymbol).OfCategory(BuiltInCategory.OST_TitleBlocks)
for tb in tb_collector:
    if tb.FamilyName == tb_name or tb.Name == tb_name:
        title_block = tb
        break
if title_block is None:
    for tb in tb_collector:
        title_block = tb
        break

all_views = FilteredElementCollector(doc).OfClass(View).ToElements()
matching_views = []
for v in all_views:
    try:
        if v.IsTemplate:
            continue
        if hasattr(v, 'Name') and v.Name.startswith(view_prefix):
            if isinstance(v, ViewPlan) or isinstance(v, ViewSection):
                matching_views.append(v)
    except:
        continue

all_schedules = {}
fec_sched = FilteredElementCollector(doc).OfClass(ViewSchedule)
for vs in fec_sched:
    all_schedules[vs.Name] = vs

all_legends = {}
for v in all_views:
    try:
        if v.ViewType == ViewType.Legend:
            all_legends[v.Name] = v
    except:
        continue

text_type = None
tt_collector = FilteredElementCollector(doc).OfClass(TextNoteType)
for tt in tt_collector:
    text_type = tt
    break

sheets_created = []
views_inserted = []
tables_inserted = []
legends_inserted = []
notes_created = []
errors = []

TransactionManager.Instance.EnsureInTransaction(doc)

if title_block and not title_block.IsActive:
    try:
        title_block.Activate()
        doc.Regenerate()
    except:
        pass

sheet_num = start_num

for idx, view in enumerate(matching_views):
    try:
        num_str = str(sheet_num).zfill(2)
        sheet_number = "PR-" + project_name + "-" + num_str
        sheet_name = view.Name
        
        tb_id = title_block.Id if title_block else ElementId.InvalidElementId
        sheet = ViewSheet.Create(doc, tb_id)
        sheet.SheetNumber = sheet_number
        sheet.Name = sheet_name
        
        view_offset = idx * (0.25 / 0.3048)
        vp_x = vw_x + view_offset
        vp_y = vw_y
        
        if Viewport.CanAddViewToSheet(doc, sheet.Id, view.Id):
            vp = Viewport.Create(doc, sheet.Id, view.Id, XYZ(vp_x, vp_y, 0))
            views_inserted.append({
                "sheetId": sheet.Id.IntegerValue,
                "viewId": view.Id.IntegerValue,
                "viewName": view.Name
            })
        
        if auto_tables:
            t_offset_y = 0
            for tn in table_names:
                if tn in all_schedules:
                    try:
                        sched = all_schedules[tn]
                        ssi_pt = XYZ(tb_x, tb_y - t_offset_y, 0)
                        ssi = ScheduleSheetInstance.Create(doc, sheet.Id, sched.Id, ssi_pt)
                        tables_inserted.append({
                            "sheetId": sheet.Id.IntegerValue,
                            "scheduleName": tn,
                            "scheduleId": sched.Id.IntegerValue
                        })
                        t_offset_y += 0.05 / 0.3048
                    except Exception as e:
                        errors.append({"type": "table", "name": tn, "error": str(e)})
        
        if auto_legends:
            l_offset_y = 0
            for ln in legend_names:
                if ln in all_legends:
                    try:
                        legend = all_legends[ln]
                        if Viewport.CanAddViewToSheet(doc, sheet.Id, legend.Id):
                            lg_pt = XYZ(lg_x, lg_y - l_offset_y, 0)
                            Viewport.Create(doc, sheet.Id, legend.Id, lg_pt)
                            legends_inserted.append({
                                "sheetId": sheet.Id.IntegerValue,
                                "legendName": ln,
                                "legendId": legend.Id.IntegerValue
                            })
                            l_offset_y += 0.15 / 0.3048
                    except Exception as e:
                        errors.append({"type": "legend", "name": ln, "error": str(e)})
        
        if note_text and text_type:
            try:
                note_x = tb_x
                note_y = tb_y - (len(table_names) * 0.05 / 0.3048) - 0.1 / 0.3048
                note_pt = XYZ(note_x, note_y, 0)
                opts = TextNoteOptions(text_type.Id)
                opts.HorizontalAlignment = HorizontalTextAlignment.Left
                tn = TextNote.Create(doc, sheet.Id, note_pt, note_text, opts)
                notes_created.append({
                    "sheetId": sheet.Id.IntegerValue,
                    "noteId": tn.Id.IntegerValue
                })
            except Exception as e:
                errors.append({"type": "note", "error": str(e)})
        
        sheets_created.append({
            "sheetId": sheet.Id.IntegerValue,
            "sheetNumber": sheet_number,
            "sheetName": sheet_name,
            "viewCount": 1,
            "tableCount": len([t for t in tables_inserted if t["sheetId"] == sheet.Id.IntegerValue]),
            "legendCount": len([l for l in legends_inserted if l["sheetId"] == sheet.Id.IntegerValue])
        })
        
        sheet_num += 1
    except Exception as e:
        errors.append({"type": "sheet", "viewName": view.Name if hasattr(view, 'Name') else "?", "error": str(e)})
        sheet_num += 1

TransactionManager.Instance.TransactionTaskDone()

end_time = time.time()

if len(sheets_created) == 0:
    status = "NENHUMA_PRANCHA"
elif len(errors) > 0:
    status = "PARCIAL"
else:
    status = "OK"

result = {
    "success": status == "OK",
    "sheetsCreated": sheets_created,
    "sheetCount": len(sheets_created),
    "viewsInserted": views_inserted,
    "viewCount": len(views_inserted),
    "tablesInserted": tables_inserted,
    "tableCount": len(tables_inserted),
    "legendsInserted": legends_inserted,
    "legendCount": len(legends_inserted),
    "notesCreated": len(notes_created) > 0,
    "noteCount": len(notes_created),
    "errors": errors,
    "errorCount": len(errors),
    "status": status,
    "executionTimeMs": int((end_time - start_time) * 1000),
    "timestamp": datetime.utcnow().isoformat() + "Z"
}

sheet_ids = [s["sheetId"] for s in sheets_created]
sheet_numbers = [s["sheetNumber"] for s in sheets_created]

OUT = [json.dumps(result, indent=2), sheet_ids, sheet_numbers, status, sheets_created, errors]
# ----------------------------------------
separar_resultados = CodeBlock(pyOut=python_gerar_pranchas)
# ---------- separar_resultados.designscript (6 lines) ----------
jsonResult = pyOut[0];
sheetIds = pyOut[1];
sheetNumbers = pyOut[2];
status = pyOut[3];
details = pyOut[4];
errors = pyOut[5];
# ----------------------------------------

# group: 3. SAÍDAS
# Sheet IDs, Numbers (PR-proj-NN), Status, Detalhes e JSON completo
watch_sheet_ids = Watch(separar_resultados.sheetIds)  # graph output
watch_sheet_numbers = Watch(separar_resultados.sheetNumbers)  # graph output
watch_status = Watch(separar_resultados.status)  # graph output
watch_detalhes_pranchas = Watch(separar_resultados.details)  # graph output
watch_out_json = Watch(separar_resultados.jsonResult)  # graph output
